# Grasshopper definition vase_xy.ghx (Grasshopper 1.0.7)
# plug-ins: ShapeDiverForGrasshopper

sddp = ShapeDiverDocumentPayload({AbsoluteTolerance=0, AngleTolerance=0, DistanceDisplayPrecision=0, GltfVersion="Gltf2", GrasshopperVersion="1.0.0007", InputGroups="{}", OutputGroups="{}", RelativeTolerance=0, RhinoVersion="7.38.24338.17001", UnitSystem=0, VersionCreated="1.14.0.0", VersionSaved="1.14.0.0"})
design_parameters = Panel("""ptx
pty""")
performance_attributes = Panel("""area
volume
height
width_mean
width_variance
length_max
tilt_max""")
reload_modules = ReloadModules(module_names="aixd_ara", reload=Button())  # inputs module_names: list, reload: Boolean
# ---------- reload_modules: Python ----------
import sys
def unload_modules(top_level_module_name):
    #copied from: 
    #https://github.com/compas-dev/compas/blob/331c38bb843dba4b428a2cad59f3ef2115061086/src/compas_rhino/utilities/misc.py#L265
    
    """Unloads all modules named starting with the specified string.
    This function eases the development workflow when editing a library that is
    used from Rhino/Grasshopper.
    Parameters
    ----------
    top_level_module_name : :obj:`str`
        Name of the top-level module to unload.
    Returns
    -------
    list
        List of unloaded module names.
    """
    modules = filter(lambda m: m.startswith(top_level_module_name), sys.modules)

    for module in modules:
        sys.modules.pop(module)

    return modules


if reload:
    for module in module_names:
        unload_modules(module)
# ---------- end reload_modules ----------
ptx = GenePool(Decimals=6, Maximum=0.5, Minimum=0.1, Value=[0.1662731693, 0.2999647009, 0.251394083, 0.4176759338, 0.4384659789])
pty = GenePool(Decimals=6, Maximum=1, Minimum=0, Value=[0.2922538688, 0.5929997026, 0.3184375927, 0.008842761632, 0.2748637746])

# ----
# Project Setup
panel = Panel("")
server = Server(start=Button(), show_window=Toggle(True))  # -> msg; inputs start: Boolean, stop: Boolean, show_window: Boolean
#   port start: Starts the server.
# ---------- server: Python ----------
from __future__ import absolute_import
from __future__ import division
from __future__ import print_function

import urllib2

import compas
import compas._os
from ghpythonlib.componentbase import executingcomponent as component
from scriptcontext import sticky as st

from aixd_ara.constants import DEFAULT_PORT

try:
    from subprocess import PIPE
    from subprocess import Popen
except ImportError:
    from System.Diagnostics import Process

import os

import aixd_ara as ag


class ApiRunner(object):
    def __init__(
        self,
        package=None,
        python=None,
        url="http://127.0.0.1",
        port=DEFAULT_PORT,
        service=None,
        max_conn_attempts=100,
        autoreload=True,
        show_window=False,
        path=None,
        working_directory=None,
    ):
        self.python = compas._os.select_python(python)
        self.service = "aixd_ara.api"
        self.working_directory = working_directory
        self.show_window = show_window
        self.port = port

        self.start_process()

    def start_process(self):
        env = compas._os.prepare_environment()

        try:
            Popen
        except NameError:
            self._process = Process()
            for name in env:
                if self._process.StartInfo.EnvironmentVariables.ContainsKey(name):
                    self._process.StartInfo.EnvironmentVariables[name] = env[name]
                else:
                    self._process.StartInfo.EnvironmentVariables.Add(name, env[name])
            self._process.StartInfo.UseShellExecute = True
            self._process.StartInfo.RedirectStandardOutput = not self.show_window
            self._process.StartInfo.RedirectStandardError = not self.show_window
            self._process.StartInfo.FileName = self.python
            self._process.StartInfo.Arguments = "-m {0} {1}".format(self.service, self.port)
            self._process.Start()
        else:
            args = [self.python, "-m", self.service, str(self.port)]
            kwargs = dict(env=env)

            if self.show_window:
                if compas.is_mono():
                    python_command = " ".join(args)
                    apple_script = """
                    tell application "Terminal"
                        do script "{}"
                        activate
                    end tell
                    """.format(
                        python_command
                    )
                    args = ["osascript", "-e", apple_script]
            else:
                kwargs["stdout"] = PIPE
                kwargs["stderr"] = PIPE

            if self.working_directory:
                kwargs["cwd"] = self.working_directory
            self._process = Popen(args, **kwargs)

    def stop_process(self):
        """Attempts to terminate the python process hosting the proxy server.

        The process reference might not be present, e.g. in the case
        of reusing an existing connection. In that case, this is a no-op.
        """
        print("Stopping the server process.")

        if not self._process:
            return

        try:
            self._process.terminate()
        except Exception:
            pass
        try:
            self._process.kill()
        except Exception:
            pass


api_path = os.path.dirname(ag.__file__)

print(api_path)


def create_api_runner_id(component):
    name = "api-runner"
    return "{}_{}".format(name, component.InstanceGuid)


class ApiRunnerComponent(component):

    def RunScript(self, start, stop, show_window=True):
        key = create_api_runner_id(self)
        port = DEFAULT_PORT

        if show_window:
            python = "python"
        else:
            python = "pythonw"

        if start:
            self.stop(key)
            runner = ApiRunner(python=python, port=port, show_window=show_window, working_directory=api_path)
            st[key] = runner

        if stop:
            self.stop(key)

    def stop(self, key):
        # Attempt gracefully stopping the server
        try:
            urllib2.urlopen("http://127.0.0.1:8765/shutdown", timeout=1)
        except Exception:
            pass

        # stop previous API runner if any
        previous_api_runner = st.get(key)
        if previous_api_runner:
            try:
                previous_api_runner.stop_process()
            except Exception as e:
                print("Unable to stop previous process")
                print(e)
            st.pop(key)
        else:
            print("No previous process runner found")
# ---------- end server ----------
reset = Reset(reset=Button())  # inputs reset: Boolean
#   port reset: Set to True to reset.
# ---------- reset: Python ----------
"""Resets the current project running in this Grasshopper file."""
# flake8: noqa

from scriptcontext import sticky as st
from aixd_ara.gh_ui import reset_session
from aixd_ara.gh_ui_helper import session_id, clear_sticky

if reset:
    reset_session(session_id())
    clear_sticky(ghenv, st)
# ---------- end reset ----------
projectsetup = ProjectSetup(set=Button(), project_root=panel, project_name="vase_xy")  # -> msg, path; inputs set: Boolean
#   port project_root: Path to the project root folder. If none is given, the default is the parent folder of this Grasshopper file.
#   port project_name: Any name for the project. It will be used to create a folder with the same name in the project root folder. All files will be later saved here.
#   port msg: Messages and errors.
#   port path: Effective path to the project.
# ---------- projectsetup: Python ----------
"""Sets up the project in the folder given by `project_root/project_name`."""
# flake8: noqa
import os

from scriptcontext import sticky as st

from aixd_ara.gh_ui import project_setup
from aixd_ara.gh_ui_helper import clear_sticky
from aixd_ara.gh_ui_helper import component_id
from aixd_ara.gh_ui_helper import session_id

if not project_root:
    ghdoc = ghenv.Component.OnPingDocument().FilePath
    project_root = os.path.dirname(ghdoc)

if project_name:
    cid = component_id(session_id(), ghenv.Component, "ProjectSetup")

    if set:
        complete_path = os.path.join(project_root, project_name)
        if not os.path.exists(complete_path):
            print("The path {} does not exist and will be now created.".format(complete_path))
            os.mkdir(complete_path)

        clear_sticky(ghenv, st)

        st[cid] = project_setup(session_id(), project_root, project_name)

    if cid in st.keys():
        msg = st[cid]["msg"]
        path = st[cid]["path"]
# ---------- end projectsetup ----------
showfolder = ShowFolder(path=projectsetup.path, open=Button())  # inputs open: Boolean
#   port path: Path to the (local) folder.
#   port open: Set to True to open the folder in the file explorer.
# ---------- showfolder: Python ----------
"""Reveals the folder in the file explorer."""
# flake8: noqa

import os

if open:
    os.startfile(path)
# ---------- end showfolder ----------
panel_2 = Panel(projectsetup.path)
panel_3 = Panel(projectsetup.msg)

# ----
# Load Dataset
load_dataset = Button()
modelsetup = ModelSetup()  # -> quick_summary, model_dims; inputs features: list, targets: list, latent_dim: Int32, hidden_layers: list of Int32, batch_size: Int32, set: Boolean
#   port model_type: Type of the autoencoder model. Options are: 'CAE' (conditional Autoencoder) and 'CVAE' (conditional Variational Autoencoder). Default: 'CAE'.
#   port features: List of variable names to be used as input to the model.
#   port targets: List of variable names to be used as output from the model.
#   port latent_dim: Dimension of the latent space.
#   port hidden_layers: Width of each hidden layer (list of int).
#   port batch_size: Size of the training batches
#   port set: Set to True to set up the model.
#   port quick_summary: Quick summary of the model.
#   port model_dims: Input and output dimensions of the model.
# ---------- modelsetup: Python ----------
"""Sets up an autoencoder model of the specified type with the given parameters. 
Requires a dataset to be loaded."""
# flake8: noqa
from scriptcontext import sticky as st

from aixd_ara.gh_ui import model_setup
from aixd_ara.gh_ui_helper import component_id
from aixd_ara.gh_ui_helper import session_id

cid = component_id(session_id(), ghenv.Component, "ModelSetup")

settings = {
    "model_type": model_type,
    "inputML": features,
    "outputML": targets,
    "latent_dim": latent_dim,
    "hidden_layers": hidden_layers,
    "batch_size": batch_size,
}


# TODO: make default settings a bit more smart
default_settings = {
    "model_type": "CAE",
    "inputML": "design_parameters",
    "outputML": "performance_attributes",
    "latent_dim": 8,
    "hidden_layers": [512, 256, 128, 64],
    "batch_size": 16,
}

for k in default_settings.keys():
    if (k not in settings) or (k in settings and settings[k] == None) or (k in settings and settings[k] == []):
        settings[k] = default_settings[k]
        print(k, default_settings[k])


if set:
    st[cid] = model_setup(session_id(), settings)


if cid in st.keys():
    quick_summary = st[cid]["quick_summary"]["summary"]
    model_dims = st[cid]["model_dims"]["summary"]
    ghenv.Component.Message = st[cid]["msg"]
# ---------- end modelsetup ----------
dp_pty = Number([0, 0.2, 0.4, 0.7, 0.8])
dp_ptx = Number([0.2, 0.4, 0.2, 0.4, 0.4])
ghpython_script = GhPythonScript(x_names=design_parameters, y_names=performance_attributes, latent_dim="3", top_k="2")  # -> out, SAE; inputs x_names: list, y_names: list, layer_widths: list of Int32, latent_dim: Int32, top_k: Int32, batch_size: Int32
# ---------- ghpython_script: Python ----------
"""
"""
# flake8: noqa
from Grasshopper.Kernel.GH_RuntimeMessageLevel import Warning


datamodule_settings = {
    'input_feature_names':   x_names or None, #default: DP
    'output_feature_names':  y_names or None, #default: PA
    'batch_size':       batch_size or 64,
}

model_settings = {

    'layer_widths': layer_widths or [128,128,128],
    'latent_dim':   latent_dim or 20,
    'topk':        top_k or 3,

}

if top_k >=latent_dim:
    ghenv.Component.AddRuntimeMessage(Warning, "Check input values: `top_k` should be less than `latent_dim`.")


class SAE_wrapper():
    def __init__(self,datamodule_settings, model_settings):
        self.model_type = 'sparse_autoencoder'
        self.datamodule_settings = datamodule_settings
        self.model_settings = model_settings
        
    def __repr__(self):
        return "SparseAutoEncoder settings"

SAE = SAE_wrapper(datamodule_settings, model_settings)
# ---------- end ghpython_script ----------
datasetonesample = DatasetOneSample(get=Button())  # -> sample_summary; inputs item: Int32, get: Boolean
#   port item: Index of the sample in the dataset, optional. If not provided, a random index will be selected.
#   port get: Set to True to retrieve a sample.
#   port sample_summary: Summary of the retrieved sample.
# ---------- datasetonesample: Python ----------
"""Retrieves one sample from the dataset (at a given or random index) and instantiates it in the parametric model. 
Requires a dataset to be loaded."""
# flake8: noqa
from scriptcontext import sticky as st

from aixd_ara.gh_ui import get_one_sample
from aixd_ara.gh_ui_helper import component_id
from aixd_ara.gh_ui_helper import instantiate_sample, sample_summary
from aixd_ara.gh_ui_helper import session_id

cid = component_id(session_id(), ghenv.Component, "DatasetOneSample")


if not item:
    item = -1

if get:
    st[cid] = get_one_sample(session_id(), item)

ghdoc = ghenv.Component.OnPingDocument()


if cid in st.keys():
    sample = st[cid]
    instantiate_sample(ghdoc, sample)

    sample_summary = sample_summary(sample)
# ---------- end datasetonesample ----------
datasetload = DatasetLoad(load=load_dataset)  # -> msg; inputs load: Boolean
#   port load: Set to True to load the dataset.
# ---------- datasetload: Python ----------
"""Loads an existing dataset from the file system, from the location specified in the project setup. It loads the dataset object and the data into the app."""
# flake8: noqa
from scriptcontext import sticky as st

from aixd_ara.gh_ui import load_dataset
from aixd_ara.gh_ui_helper import component_id
from aixd_ara.gh_ui_helper import session_id

cid = component_id(session_id(), ghenv.Component, "DatasetLoad")

if load:
    st[cid] = load_dataset(session_id())

if cid in st.keys():
    msg = st[cid]["msg"]
# ---------- end datasetload ----------
datasetsummary = DatasetSummary(get=Button())  # -> summary; inputs get: Boolean
#   port get: Set to True to get the summary of the dataset.
#   port summary: Summary of the dataset.
# ---------- datasetsummary: Python ----------
"""Provides a summary of the dataset."""
# flake8: noqa
from scriptcontext import sticky as st

from aixd_ara.gh_ui import dataset_summary
from aixd_ara.gh_ui_helper import component_id
from aixd_ara.gh_ui_helper import session_id

cid = component_id(session_id(), ghenv.Component, "DatasetSummary")

if get:
    st[cid] = dataset_summary(session_id())

if cid in st.keys():
    if st[cid]["msg"]:
        summary = st[cid]["msg"]  # error
    else:
        summary = st[cid]["summary"]
# ---------- end datasetsummary ----------
cluster = Cluster(ptx=dp_ptx, pty=dp_pty)  # -> controlpts, profilecrv, vase3d, height, area_2, volume_2, width_mean, width_variance, length_max, tilt_max
modelsetup_2 = ModelSetup(embedding_setup=ghpython_script.SAE, train=Button())  # inputs train: Boolean
#   port embedding_setup: Type of the autoencoder model. Options are: 'CAE' (conditional Autoencoder) and 'CVAE' (conditional Variational Autoencoder). Default: 'CAE'.
#   port train: Set to True to set up the model.
# ---------- modelsetup_2: Python ----------
"""

"""
# flake8: noqa
from scriptcontext import sticky as st

from aixd_ara.gh_ui import embeddings_setup_and_train
from aixd_ara.gh_ui_helper import component_id
from aixd_ara.gh_ui_helper import session_id

cid = component_id(session_id(), ghenv.Component, "EmbeddingTrain")



training_settings = {
    'max_epochs':   max_epochs or 10
    }

settings = {
    'model_type':embedding_setup.model_type,
    'datamodule_settings':embedding_setup.datamodule_settings,
    'model_settings': embedding_setup.model_settings,
    'training_settings': training_settings
    }

if _train:
    ghenv.Component.Message = ""
    st[cid] = embeddings_setup_and_train(session_id(), settings)


if cid in st.keys():
    ghenv.Component.Message = st[cid]["msg"]
# ---------- end modelsetup_2 ----------
ghpython_script_2 = GhPythonScript(embed=Button())  # -> out, uids, vecs; inputs embed: Boolean
# ---------- ghpython_script_2: Python ----------
"""

"""
# flake8: noqa
from scriptcontext import sticky as st
import Rhino.Geometry as rg

from aixd_ara.gh_ui import embed_all
from aixd_ara.gh_ui_helper import component_id
from aixd_ara.gh_ui_helper import session_id

from Grasshopper.Kernel.GH_RuntimeMessageLevel import Warning, Error

cid = component_id(session_id(), ghenv.Component, "Embed")



if _embed:
    st[cid] = embed_all(session_id())


if cid in st.keys():
    ghenv.Component.Message = st[cid]["msg"]
    uids = st[cid]["res"]["uids"]
    vecs = st[cid]["res"]["embvecs"]
    
    # reformat into Rhino vectors:
    dim = len(vecs[0])
    if dim==2:
        vecs = [rg.Point3d(x,y,0) for x,y in vecs]
    elif dim==3:
        vecs = [rg.Point3d(x,y,z) for x,y,z in vecs]
    else:
        #ghenv.Component.Message = st[cid]["msg"]
        ghenv.Component.AddRuntimeMessage(Error, "Embedding is {}-dimensional. Should be 2D or 3D.".format(dim))
# ---------- end ghpython_script_2 ----------
panel_4 = Panel(datasetsummary)
panel_5 = Panel(datasetonesample)
panel_6 = Panel(datasetload)
pa_width_variance = Number(cluster.width_variance)
pa_width_mean = Number(cluster.width_mean)
pa_length_max = Number(cluster.length_max)
pa_volume = Number(cluster.volume_2)
pa_tilt_max = Number(cluster.tilt_max)
pa_height = Number(cluster.height)
pa_area = Number(cluster.area_2)
geometry = Geometry([cluster.profilecrv, cluster.controlpts])
brep = Brep(cluster.vase3d)
button = Button()
datasetsummary_2 = DatasetSummary(get=button)  # -> summary; inputs get: Boolean
#   port get: Set to True to get the summary of the dataset.
#   port summary: Summary of the dataset.
# ---------- datasetsummary_2: Python ----------
"""Provides a summary of the dataset. 
Requires a dataset to be loaded."""
# flake8: noqa
from scriptcontext import sticky as st

from aixd_ara.gh_ui import dataset_summary
from aixd_ara.gh_ui_helper import component_id
from aixd_ara.gh_ui_helper import session_id

cid = component_id(session_id(), ghenv.Component, "DatasetSummary")

if get:
    st[cid] = dataset_summary(session_id())

if cid in st.keys():
    if st[cid]["msg"]:
        summary = st[cid]["msg"]  # error
    else:
        summary = st[cid]["summary"]
# ---------- end datasetsummary_2 ----------
dataobjectsnames = DataObjectsNames(get_names=button)  # inputs get_names: Boolean
#   port get_names: Set to True to run.
# ---------- dataobjectsnames: Python ----------
"""Generates panels with list of names of data objects for all existing data blocks."""
# flake8: noqa

# this code has been inspired by a forum post by "chanley" (2018.11.02)
# https://discourse.mcneel.com/t/can-i-instantiate-specific-component-on-the-canvas-with-a-script-python/74204/8

import Grasshopper
import System.Drawing as sd

from aixd_ara.gh_ui import get_dataobject_names_from_block
from aixd_ara.gh_ui_helper import session_id

comp = ghenv.Component
ghdoc = comp.OnPingDocument()


def make_Panel(NickName, UserText, Pivot, Bounds):
    try:
        Panel = Grasshopper.Kernel.Special.GH_Panel()
        Panel.NickName = NickName
        Panel.UserText = UserText
        Panel.Properties.Colour = sd.Color.White
        # Panel.Properties.Font = sd.Font("Trebuchet MS", 10)
        Panel.Properties.Multiline = False
        Panel.Properties.DrawIndices = False
        Panel.Properties.DrawPaths = False
        ghdoc.AddObject(Panel, False, ghdoc.ObjectCount + 1)
        Panel.Attributes.Pivot = Pivot
        Panel.Attributes.Bounds = Bounds
    except Exception(ex):
        ghenv.Component.AddRuntimeMessage(Grasshopper.Kernel.GH_RuntimeMessageLevel.Warning, str(ex))


x = ghenv.Component.Attributes.DocObject.Attributes.Bounds.Right
y = ghenv.Component.Attributes.DocObject.Attributes.Bounds.Top

w = 150
h = 150
gap = 50

errors = ""

datablocks = ["design_parameters", "performance_attributes", "inputML", "outputML"]  # all datablock names

if get_names:

    for i, datablock_nickname in enumerate(datablocks):
        panel_title = datablock_nickname
        response = get_dataobject_names_from_block(session_id(), datablock_nickname)
        text_items = response["names"]
        if text_items:
            text_str = "\n".join(text_items)
            pt = sd.PointF(x + gap + i * gap, y + i * gap)
            rect = sd.RectangleF(0, 0, w, h)
            make_Panel(panel_title, text_str, pt, rect)
        else:
            errors += response["msg"] + "\n"

if errors:
    ghenv.Component.AddRuntimeMessage(Grasshopper.Kernel.GH_RuntimeMessageLevel.Warning, str(errors))
# ---------- end dataobjectsnames ----------
custom_preview = CustomPreview(Geometry=geometry, Material=ColourSwatch(SwatchColor=RGB(0, 126, 204)))
custom_preview_2 = CustomPreview(Geometry=brep, Material=ColourSwatch(SwatchColor=RGB(204, 204, 204)))
datasetcreate = DatasetCreate()  # -> msg; inputs design_parameters: list, performance_attributes: list, create: Boolean
#   port design_parameters: Design parameters: list of data objects.
#   port performance_attributes: Performance attributes: list of data objects.
#   port create: Set to True to create a dataset object. If a dataset already exists in the project path, nothing will happen. To create a new dataset, change the project path or dataset name or delete the existing dataset.
#   port msg: Message or error.
# ---------- datasetcreate: Python ----------
"""Creates a dataset object. This defines the structure of the dataset. It does not cointain any data."""
# flake8: noqa
from scriptcontext import sticky as st
from Grasshopper.Kernel.GH_RuntimeMessageLevel import Warning

from aixd_ara.gh_ui import create_dataset_object
from aixd_ara.gh_ui_helper import component_id
from aixd_ara.gh_ui_helper import session_id

cid = component_id(session_id(), ghenv.Component, "DatasetCreate")


design_parameters = [x.data for x in design_parameters]
performance_attributes = [x.data for x in performance_attributes]


if create:
    st[cid] = create_dataset_object(session_id(), design_parameters, performance_attributes)

if cid in st.keys():
    msg = st[cid]["msg"]
    if st[cid]["status"]=="warning":
        ghenv.Component.AddRuntimeMessage(Warning, msg)
# ---------- end datasetcreate ----------

# ==== cluster Cluster
# Does not exactly match the pure-python version!
# * height - limit to last slice
# * area, volume - more accurate
# * tilt - more accurate
ptx = ClusterInput()
pty = ClusterInput()
ghpython_script = GhPythonScript(ptx=ptx, pty=pty)  # -> out, flatten(pts); inputs ptx: list, pty: list
# ---------- ghpython_script: Python ----------
def sort_control_points(pts):
    pts = [list(pt) for pt in pts]  # Ensure mutable copies of points
    pts.sort(key=lambda x: x[1])  # Sort by the second element (y-coordinate)
    zmin = min(pt[1] for pt in pts)  # Find the minimum y-coordinate
    for pt in pts:
        pt[1] -= zmin  # Adjust y-coordinates
    return pts
    

pts = zip(ptx,pty)

pts = sort_control_points(pts)


import Rhino.Geometry as rg
pts = [rg.Point3d(x,0,y) for x,y in pts]
# ---------- end ghpython_script ----------
colour_swatch = ColourSwatch(SwatchColor=RGB(255, 255, 255))  # disabled
ghpython_script_2 = GhPythonScript(pts=ghpython_script.pts)  # -> out, flatten(width_mean), flatten(width_variance), flatten(length_max), Bezier; inputs pts: list of Point3d
# ---------- ghpython_script_2: Python ----------
import Rhino.Geometry as rg
import math

def create_profile_curve(control_points, subsampling=100):
    """
    Samples a Bezier curve given by control points pts.
    Returns x and y coordinates of the sampled points in separate arrays.
    """
    s = subsampling  # subsampling, number of sample points +1

    cpx,cpy  = control_points
    spx = [__Bezier_t(cpx, t * 1 / s) for t in range(s)]
    spy = [__Bezier_t(cpy, t * 1 / s) for t in range(s)]

    return spx, spy

def __Bezier_t(pts, t):
    """
    Evaluates Bezier curve equation for a single coordinate at a single parameter value t
    """
    d = len(pts)
    n = d - 1
    return sum(
        #[math.comb(n, i) * (1 - t) ** (n - i) * t**i * pts[i] for i in range(d)]
        [math.factorial(n) // (math.factorial(i) * math.factorial(n - i)) * (1 - t) ** (n - i) * t**i * pts[i] for i in range(d)]
    )
    

#------------------------------------
# CURVE

control_points = [[p.X for p in pts],[p.Z for p in pts]]

spx, spy = create_profile_curve(control_points)

Bezier = rg.Polyline([rg.Point3d(x,0,z) for x,z in zip(spx,spy)]).ToNurbsCurve()

#------------------------------------
# ANALYSIS

n=len(spx)

width_mean = mean = sum(spx) / n

width_variance = sum((xi - width_mean) ** 2 for xi in spx) / n

height = max(spy)


rmax = max(spx)
length_max = 2 * math.pi * rmax
# ---------- end ghpython_script_2 ----------
nurbs_curve = NurbsCurve(Vertices=ghpython_script.pts, Degree=4, Periodic=False)  # -> Curve, Length, Domain

# ----
# Calculate max tilt (max angle to vertical)
# * using actual slices (using layer thickness)
# * from tangents at sampled points
layer_thickness = Panel("0.01 ")
series = Series(Start=0, Step=layer_thickness, Count=expr("101", 10))
contour_ex = ContourEx(Curve=nurbs_curve.Curve, Plane=PlaneXY(0, 0, 0), Offsets=series)  # -> flatten(Contours), Parameters
polyline = PolyLine(Vertices=contour_ex.Contours, Closed=False)
range = Range(Domain=Domain(0, 1), Steps=100)
explode = Explode(Curve=polyline, Recursive=True)  # -> Segments, Vertices
evaluate_curve = EvaluateCurve(Curve=reparameterize(nurbs_curve.Curve), Parameter=range)  # -> Point, Tangent, Angle
vector = Vector(explode.Segments)
angle = Angle(VectorA=evaluate_curve.Tangent, VectorB=Vector(0, 0, 1))  # -> Angle, Reflex
angle_2 = Angle(VectorA=vector, VectorB=Vector(0, 0, 1))  # -> Angle, Reflex
degrees = Degrees(Radians=angle.Angle)
degrees_2 = Degrees(Radians=angle_2.Angle)
min_max = MinMax(Number=degrees_2)  # -> Minimum, flatten(Maximum)
min_max_2 = MinMax(Number=degrees)  # -> Minimum, Maximum
panel = Panel(min_max.Maximum)
panel_2 = Panel(min_max_2.Maximum)

custom_preview = CustomPreview(Geometry=ghpython_script_2.Bezier, Material=colour_swatch)  # disabled
ghpython_script_3 = GhPythonScript(crv=nurbs_curve.Curve)  # -> out, crv; inputs crv: Curve
# ---------- ghpython_script_3: Python ----------
# add bottom

import Rhino.Geometry as rg


bottom = rg.Line(rg.Point3d(0,0,0), crv.PointAtStart).ToNurbsCurve()

crv_ = rg.NurbsCurve.JoinCurves([crv,bottom])
# ---------- end ghpython_script_3 ----------
revolution = Revolution(Curve=ghpython_script_3.crv, Axis=Line((0, 0, 0), (0, 0, 1)), Domain=Domain(0, 6.283185307))
cap_holes = CapHoles(Brep=revolution)
volume = Volume(Geometry=cap_holes)  # -> flatten(Volume), Centroid
area = Area(Geometry=revolution)  # -> flatten(Area), Centroid
ghpython_script_4 = GhPythonScript(pts=ghpython_script.pts)  # -> flatten(height); inputs pts: list of Point3d
# ---------- ghpython_script_4: Python ----------
height= pts[-1].Z
# ---------- end ghpython_script_4 ----------
controlpts = ClusterOutput(ghpython_script.pts)
profilecrv = ClusterOutput(nurbs_curve.Curve)
vase3d = ClusterOutput(revolution)
height = ClusterOutput(ghpython_script_4)
area_2 = ClusterOutput(area.Area)
volume_2 = ClusterOutput(volume.Volume)
width_mean = ClusterOutput(ghpython_script_2.width_mean)
width_variance = ClusterOutput(ghpython_script_2.width_variance)
length_max = ClusterOutput(ghpython_script_2.length_max)
tilt_max = ClusterOutput(min_max.Maximum)
